# Grasshopper definition L'OREAL - TEST MULTITHREADING VIA HOPS - MAILLAGE EN SURFACE - RH7 - 12-04-2021.gh (Grasshopper 1.0.7)
# plug-ins: MeshEdit Components

maillage_deltaz_positif = GetGeometry(AtLeast=1, AtMost=2147483647, Filter=1074004029)
mailages_faces = GetGeometry(AtLeast=1, AtMost=2147483647, Filter=1074004029)
maillage_deltaz_positif_2 = Mesh(flatten(maillage_deltaz_positif))
maillages_faces = Mesh(flatten(mailages_faces))
mailages_faces_2 = Mesh(flatten(maillages_faces))
mesh = Mesh(maillage_deltaz_positif_2)
mesh_area = MeshArea(Mesh=mailages_faces_2)  # -> Area, Centroid
point = Point(mesh_area.Centroid)
unit_z = UnitZ(Factor=1)
line_sdl = LineSDL(Start=point, Direction=unit_z, Length=Slider(1, range=0..1))
mesh_curve = MeshCurve(Mesh=mesh, Curve=line_sdl)  # -> Points, Faces
list_length = ListLength(List=mesh_curve.Points)  # -> flatten(Length)
mesh_2 = Mesh(flatten(mailages_faces_2))
equality = Equality(FirstNumber=list_length, SecondNumber=Slider(1, range=0..1))  # -> Equality, Inequality
dispatch = Dispatch(List=mesh_2, DispatchPattern=equality.Equality)  # -> ListA, ListB

# ---- group: RH_OUT:Mailages faces en surface
mailages_faces_en_surface = Mesh(flatten(dispatch.ListA))
